# Grasshopper definition assembled_speckle.gh (Grasshopper 1.0.7)
# plug-ins: Speckle 2, Bifocals, eleFront

# ---- group: BIMSC-PROJECT
# Send a message to James M. to add
# new materials. This list will be updated
# for all groups to have a common material
# library and common material names.
panel = Panel("FRAGMENTS OF A MARTIAN ROSE")
bimsc_project = Text(panel)

# ---- group: FLOOR_LEVELS
# Set your 'Project' name, your 'Group'
# number, your 'Volume' Location that
# connect wirelessly.
series = Series(Start=0, Step=1, Count="5")
expression = Expression(x=series, Expression="Format(\"{0:00}\", x)")
# PROJECT
# INPUTS
concat = Concatenate(FragmentA="L", FragmentB=expression)  # -> simplify(graft(Result))
floor_levels = Text(concat)

# ---- group: RECEIVE MATERIALS
# RECIEVE
# MATERIALS
panel_2 = Panel("https://macad.speckle.xyz/streams/4975f9f0a8/branches/site%2F05-materials")
receive = Receive(
    Stream=panel_2,
    AutoReceive=False,
    CurrentComponentState="expired",
    ExpandOutput=True,
    LastInfoMessage="James McBennett @ 03/02/2024 01:57:29: Materials 01-03-2024 (id:6ecf38526e)",
    ReceiveOnOpen=False,
    ReceivedCommitId="6ecf38526e",
    StreamWrapper="https://macad.speckle.xyz/streams/4975f9f0a8/branches/site/05-materials",
    selectedKitName="Objects")  # -> Info, Materials
dso = DeconstructSpeckleObject(SpeckleObject=receive.Materials, selectedKitName="Objects")  # -> Glass, Regolith, Site

# ---- group: BIMSC-ORIGINATOR
bimsc_originator = Text("G06")

# ---- group: BIMSC-VOLUME
bimsc_volume = Text("A4")

# ---- group: WorksForBrepsAndMeshes
list = ValueList({"Srf/Brep": 0, "Mesh": 1}, selected="Mesh")

# ----
srf = Surface([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])
mesh = Mesh([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])
srf_2 = Surface(Tree({0}: [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], {1}: [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], {2}: [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], {3}: [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], {4}: [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]))
mesh_2 = Mesh(Tree({0}: [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], {1}: [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], {2}: [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], {3}: [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], {4}: [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]))
brep = Brep(Tree({0}: [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], {1}: [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], {2}: [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], {3}: [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], {4}: [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]))
mesh_3 = Mesh(Tree({0}: [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], {1}: [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], {2}: [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], {3}: [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], {4}: [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]))

# ---- group: Alternative Method Using Extend Speckle Object by Key/Value / LEVEL
floor_levels_2 = Text(floor_levels)

# ---- group: Alternative Method Using Extend Speckle Object by Key/Value / PHASE
# ALTERNATIVE
num = Number(Tree({0}: [1], {1}: [1], {2}: [2], {3}: [2], {4}: [3]))

# ---- group: SiteCutCrv
crv = Curve(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)

# ---- group: NewSiteMesh
# SITE
mesh_4 = Mesh(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)

# ----
srf_3 = Surface(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)

merge = Merge(Data1=flatten(crv), Data2=flatten(mesh_4))  # -> simplify(graft(Result))
name = ExtendSpeckleObject(
    SpeckleObject=merge,
    BIMSCPROJECT=bimsc_project,
    BIMSCORIGINATOR=bimsc_originator,
    BIMSCVOLUME=bimsc_volume,
    BIMSCLEVEL="L00",
    BIMSCTYPE="SITE",
    BIMSCMATERIAL="SITE",
    RenderMaterial=dso.Site,
    BIMSCPHASE="1",
    selectedKitName="Objects")  # -> flatten(ExtendedSpeckleObject)

# ---- group: LEVEL
txt = Text(Tree({0}: ["L00"], {1}: ["L04"]))

# ---- group: PHASE
num_2 = Number(Tree({0}: [1], {1}: [3]))

# ----
# ASSIGN MATERIALS
# AND FILTERS
filter = StreamFilter(Gate=list, Stream0=srf, Stream1=mesh)  # -> reverse(simplify(graft(Stream)))
name_2 = ExtendSpeckleObject(
    SpeckleObject=filter,
    BIMSCPROJECT=bimsc_project,
    BIMSCORIGINATOR=bimsc_originator,
    BIMSCVOLUME=bimsc_volume,
    BIMSCLEVEL=txt,
    BIMSCTYPE="ROOF",
    BIMSCMATERIAL="REGOLITH",
    RenderMaterial=dso.Regolith,
    BIMSCPHASE=num_2,
    selectedKitName="Objects")

# ---- group: PHASE
num_3 = Number(Tree({0}: [1], {1}: [1], {2}: [2], {3}: [2], {4}: [3]))

# ---- group: LEVEL
floor_levels_3 = Text(floor_levels)

# ----
filter_2 = StreamFilter(Gate=list, Stream0=srf_2, Stream1=mesh_2)
name_3 = ExtendSpeckleObject(
    SpeckleObject=filter_2,
    BIMSCPROJECT=bimsc_project,
    BIMSCORIGINATOR=bimsc_originator,
    BIMSCVOLUME=bimsc_volume,
    BIMSCLEVEL=floor_levels_3,
    BIMSCTYPE="WINDOW",
    BIMSCMATERIAL="GLASS",
    RenderMaterial=dso.Glass,
    BIMSCPHASE=num_3,
    selectedKitName="Objects")  # -> flatten(ExtendedSpeckleObject)

# ---- group: Alternative Method Using Extend Speckle Object by Key/Value
# Alternative method using keys and
# values. You will need to 'cross reference'
# or 'repeat-duplicate' data to create the
# correct set of keys and values for your
# model as in panel on the right.
panel_3 = Panel("WINDOW")
crossref = CrossReference(
    ListBIMSCPROJECT=bimsc_project,
    ListBIMSCORIGINATOR=bimsc_originator,
    ListBIMSCVOLUME=bimsc_volume,
    ListBIMSCLEVEL=floor_levels_2,
    ListBIMSCTYPE=panel_3,
    ListBIMSCMATERIAL="GLASS",
    ListRenderMaterial=dso.Glass,
    ListBIMSCPHASE=num,
    CrossMode=1)  # -> ListBIMSCPROJECT, ListBIMSCORIGINATOR, ListBIMSCVOLUME, ListBIMSCLEVEL, ListBIMSCTYPE, ListBIMSCMATERIAL, ListRenderMaterial, ListBIMSCPHASE
merge_2 = Merge(
    Data1=crossref.ListBIMSCPROJECT,
    Data2=crossref.ListBIMSCORIGINATOR,
    Data3=crossref.ListBIMSCVOLUME,
    Data4=crossref.ListBIMSCLEVEL,
    Data5=crossref.ListBIMSCTYPE,
    Data6=crossref.ListBIMSCMATERIAL,
    Data7=crossref.ListRenderMaterial,
    Data8=crossref.ListBIMSCPHASE)
panel_4 = Panel("""BIMSC-PROJECT
BIMSC-ORIGINATOR
BIMSC-VOLUME
BIMSC-LEVEL
BIMSC-TYPE
BIMSC-MATERIAL
renderMaterial
BIMSC-PHASE""")
panel_5 = Panel(merge_2)
esokv = ExtendSpeckleObjectByKeyValue(SpeckleObject=filter_2, Keys=panel_4, Values=merge_2, selectedKitName="Objects")  # -> flatten(ExtendedSpeckleObject)

# ---- group: PHASE
num_4 = Number(Tree({0}: [1], {1}: [1], {2}: [2], {3}: [2], {4}: [3]))

# ---- group: LEVEL
floor_levels_4 = Text(floor_levels)

# ----
filter_3 = StreamFilter(Gate=list, Stream0=brep, Stream1=mesh_3)
lng = ListLength(List=filter_3)
series_2 = Series(Start=0, Step=1, Count=lng)
# If you would like to set your own
# Speckle Material Properties, do
# so with this component. You can
# use this setup to create gradients.
gradient = Gradient(
    LowerLimit=0,
    UpperLimit=lng,
    Parameter=series_2,
    stops=[0: RGB(234, 38, 0), 0.25: RGB(234, 126, 0), 0.5: RGB(254, 244, 84), 0.75: RGB(173, 203, 249), 1: RGB(75, 107, 169)])
sso = RenderMaterial(
    Opacity=Slider(1, range=0..1),
    Metalness=0,
    Roughness=1,
    Diffuse=gradient,
    SelectedConstructorName="Objects.Other.RenderMaterial.ctor(System.Double,System.Double,System.Double,System.Nullable`1[System.Drawing.Color],System.Nullable`1[System.Drawing.Color])",
    SelectedTypeName="Objects.Other.RenderMaterial",
    UseSchemaTag=False,
    UserSetSchemaTag=False,
    seed="8778421604ba247de87e")  # -> simplify(SpeckleObject)
name_4 = ExtendSpeckleObject(
    SpeckleObject=filter_3,
    BIMSCPROJECT=bimsc_project,
    BIMSCORIGINATOR=bimsc_originator,
    BIMSCVOLUME=bimsc_volume,
    BIMSCLEVEL=floor_levels_4,
    BIMSCTYPE="WALL",
    BIMSCMATERIAL="REGOLITH",
    RenderMaterial=sso,
    BIMSCPHASE=num_4,
    selectedKitName="Objects")  # -> flatten(ExtendedSpeckleObject)

panel_6 = Panel("https://macad.speckle.xyz/streams/4975f9f0a8/branches/site/04-community-site")
receive_2 = Receive(
    Stream=panel_6,
    AutoReceive=False,
    CurrentComponentState="expired",
    ExpandOutput=True,
    LastInfoMessage="James McBennett @ 03/01/2024 23:14:17: 2024 Mar-01 (id:9ec35295b2)",
    ReceiveOnOpen=False,
    ReceivedCommitId="9ec35295b2",
    StreamWrapper="https://macad.speckle.xyz/streams/4975f9f0a8/branches/site/04-community-site",
    selectedKitName="Objects")  # -> Info, CONTOURS, SOIL
# EDIT SITE MESH
item = ListItem(List=flatten(receive_2.SOIL), Index=Slider(3, range=0..17), Wrap=True)
bbox = BoundingBox(Content=srf_3, Plane=PlaneXY(0, 0, 0))  # -> Box, Box_2
volume = Volume(Geometry=bbox.Box)  # -> Volume, Centroid
msphere = MeshSphere(Base=volume.Centroid, Radius="30000", UCount="100", VCount="100")
msplit = MeshSplit(Mesh=item, Splitters=msphere)

mmx = MeshMesh(MeshA=item, MeshB=msphere)

# ----
# SEND
panel_7 = Panel("https://macad.speckle.xyz/streams/fb7821e9f3/branches/main")
cso = CreateSpeckleObject(ROOF=name_2, WALL=name_4, WINDOW=name_3, SITE=name, selectedKitName="Objects")
send = Send(
    Stream=panel_7,
    Message="Test",
    D=cso,
    AutoSend=False,
    BaseId="6a982903f45783bb54a2832a9ef6a595",
    CurrentComponentState="expired",
    KitName="Objects",
    OutputWrappers="https://macad.speckle.xyz\tfb7821e9f3\tcd98566eea",
    UseDefaultCache=True,
    selectedKitName="Objects")

# ----
# add actual units
panel_8 = Panel("Contours")
# filter terrain
panel_9 = Panel("BakedStudioMarsTopoMain")
reflay = ReferenceByLayer(LayerName=panel_9, lightweight=False)
reflay_2 = ReferenceByLayer(LayerName=panel_8, lightweight=False)
reflay_3 = ReferenceByLayer(LayerName="TopoBrep", lightweight=False)
reflay_4 = ReferenceByLayer(LayerName="TopoMesh", lightweight=False)
list_2 = ValueList({"AngularDimension", "Arc", "Block", "Brep", "Circle", "Curve", "Dimension", "Ellipse", "Extrusion", "Hatch", "Leader", "Line", "LinearDimension", "Mesh", "Point", "Polyline", "Polysurface", "RadialDimension", "Surface", "Text", "TextDot"}, selected="Mesh")
panel_10 = Panel(reflay)
panel_11 = Panel(reflay_2)
panel_12 = Panel(reflay_3)
panel_13 = Panel(reflay_4)
filtertype = FilterByType(ObjectType=list_2, Geometry=reflay, invertFilter=False, returnNulls=False)  # -> ExcludedGeometry, IncludedGeometry
mesh_5 = MeshBrep(
    Brep=reflay_3,
    Settings={GridMaxCount=0, GridMinCount=16, JaggedSeams=False, MaxEdgeLength=0, MinEdgeLength=0.0001, MinTolerance=0, Refine=True, RefineAngle=0, RelativeTolerance=0.65, SimplePlanes=True, Tolerance=0})
brep_2 = Brep(reflay_3)
mesh_6 = Mesh(reflay_4)
mesh_7 = Mesh(filtertype.IncludedGeometry)
faceb = FaceBoundaries(Mesh=mesh_7)
faceb_2 = FaceBoundaries(Mesh=mesh_6)
boundary = BoundarySurfaces(Edges=faceb)
boundary_2 = BoundarySurfaces(Edges=faceb_2)
join = BrepJoin(Breps=boundary)  # -> Breps, Closed
mesh_8 = Mesh(filtertype.IncludedGeometry)
join_2 = BrepJoin(Breps=boundary_2)  # -> Breps, Closed
mesh_9 = Mesh(reflay_4)

# ---- group: BIMSC-PROJECT
# Send a message to James M. to add
# new materials. This list will be updated
# for all groups to have a common material
# library and common material names.
panel_14 = Panel("ELEMENTAL MARS")
bimsc_project_2 = Text(panel_14)

# ---- group: FLOOR_LEVELS
# Set your 'Project' name, your 'Group'
# number, your 'Volume' Location that
# connect wirelessly.
series_3 = Series(Start=0, Step=1, Count="5")
expression_2 = Expression(x=series_3, Expression="Format(\"{0:00}\", x)")
# FLOORS
concat_2 = Concatenate(FragmentA="L", FragmentB=expression_2)  # -> simplify(graft(Result))
floor_levels_5 = Text(concat_2)

# ---- group: RECEIVE MATERIALS
# RECIEVE
# MATERIALS
panel_15 = Panel("https://macad.speckle.xyz/streams/4975f9f0a8/branches/site%2F05-materials")
receive_3 = Receive(
    Stream=panel_15,
    AutoReceive=False,
    CurrentComponentState="up_to_date",
    ExpandOutput=True,
    LastInfoMessage="James McBennett @ 03/02/2024 01:57:29: Materials 01-03-2024 (id:6ecf38526e)",
    ReceiveOnOpen=False,
    ReceivedCommitId="6ecf38526e",
    StreamWrapper="https://macad.speckle.xyz/streams/4975f9f0a8/branches/site/05-materials",
    selectedKitName="Objects")  # -> Info, Materials
# UNITS
dso_2 = DeconstructSpeckleObject(SpeckleObject=receive_3.Materials, selectedKitName="Objects")  # -> Glass, Inflatable, Insulation, Mineral, Regolith, Site, Soil, Steel

# ---- group: BIMSC-ORIGINATOR
bimsc_originator_2 = Text("G06")

# ---- group: BIMSC-VOLUME
bimsc_volume_2 = Text("A4")

# ----
# ROOFS
panel_16 = Panel("Roof")
reflay_5 = ReferenceByLayer(LayerName=panel_16, lightweight=False, DisableAutoUpdate=False)
panel_17 = Panel(reflay_5)
mesh_10 = Mesh(reflay_5)
faceb_3 = FaceBoundaries(Mesh=mesh_10)
boundary_3 = BoundarySurfaces(Edges=faceb_3)
join_3 = BrepJoin(Breps=boundary_3)  # -> Breps, Closed
mesh_11 = Mesh(reflay_5)

# ----
# WALLS
panel_18 = Panel("Wall")
reflay_6 = ReferenceByLayer(LayerName=panel_18, lightweight=False, DisableAutoUpdate=False)
panel_19 = Panel(reflay_6)
mesh_12 = MeshBrep(
    Brep=reflay_6,
    Settings={GridMaxCount=0, GridMinCount=16, JaggedSeams=False, MaxEdgeLength=0, MinEdgeLength=0.0001, MinTolerance=0, Refine=True, RefineAngle=0, RelativeTolerance=0.65, SimplePlanes=True, Tolerance=0})
brep_3 = Brep(reflay_6)
mjoin = MeshJoin(Meshes=mesh_12)
weld = WeldMesh(Mesh=mjoin, Angle=3.141592654)

reflay_7 = ReferenceByLayer(LayerName="Pods", lightweight=False, DisableAutoUpdate=False)
panel_20 = Panel(reflay_7)
mesh_13 = MeshBrep(
    Brep=reflay_7,
    Settings={GridMaxCount=0, GridMinCount=16, JaggedSeams=False, MaxEdgeLength=0, MinEdgeLength=0.0001, MinTolerance=0, Refine=True, RefineAngle=0, RelativeTolerance=0.65, SimplePlanes=True, Tolerance=0})
brep_4 = Brep(reflay_7)
mjoin_2 = MeshJoin(Meshes=mesh_13)
weld_2 = WeldMesh(Mesh=mjoin_2, Angle=3.141592654)

reflay_8 = ReferenceByLayer(LayerName="Floors", lightweight=False, DisableAutoUpdate=False)
panel_21 = Panel(reflay_8)
mesh_14 = MeshBrep(
    Brep=reflay_8,
    Settings={GridMaxCount=0, GridMinCount=16, JaggedSeams=False, MaxEdgeLength=0, MinEdgeLength=0.0001, MinTolerance=0, Refine=True, RefineAngle=0, RelativeTolerance=0.65, SimplePlanes=True, Tolerance=0})
brep_5 = Brep(reflay_8)
mjoin_3 = MeshJoin(Meshes=mesh_14)
weld_3 = WeldMesh(Mesh=mjoin_3, Angle=3.141592654)

reflay_9 = ReferenceByLayer(LayerName="UnitsRawVolumes", lightweight=False, DisableAutoUpdate=False)
panel_22 = Panel(reflay_9)
mesh_15 = MeshBrep(
    Brep=reflay_9,
    Settings={GridMaxCount=0, GridMinCount=16, JaggedSeams=False, MaxEdgeLength=0, MinEdgeLength=0.0001, MinTolerance=0, Refine=True, RefineAngle=0, RelativeTolerance=0.65, SimplePlanes=True, Tolerance=0})
brep_6 = Brep(reflay_9)
mjoin_4 = MeshJoin(Meshes=mesh_15)
weld_4 = WeldMesh(Mesh=mjoin_4, Angle=3.141592654)

reflay_10 = ReferenceByLayer(LayerName="UnitsFloors", lightweight=False, DisableAutoUpdate=False)
panel_23 = Panel(reflay_10)
mesh_16 = MeshBrep(
    Brep=reflay_10,
    Settings={GridMaxCount=0, GridMinCount=16, JaggedSeams=False, MaxEdgeLength=0, MinEdgeLength=0.0001, MinTolerance=0, Refine=True, RefineAngle=0, RelativeTolerance=0.65, SimplePlanes=True, Tolerance=0})
# TERRAIN
brep_7 = Brep(reflay_10)
mjoin_5 = MeshJoin(Meshes=mesh_16)
weld_5 = WeldMesh(Mesh=mjoin_5, Angle=3.141592654)

# ---- group: WorksForBrepsAndMeshes
list_3 = ValueList({"Srf/Brep": 0, "Mesh": 1}, selected="Mesh")

# ----
srf_4 = Surface(Tree({0}: [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], {1}: [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], {2}: [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], {3}: [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], {4}: [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]))
mesh_17 = Mesh(Tree({0}: [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], {1}: [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], {2}: [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], {3}: [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], {4}: [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]))

# ---- group: SiteCutCrv
crv_2 = Curve(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)

# ---- group: NewSiteMesh
# SITE
mesh_18 = Mesh(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)

# ----
srf_5 = Surface(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)

merge_3 = Merge(Data1=flatten(crv_2), Data2=flatten(mesh_18))  # -> simplify(graft(Result))
name_5 = ExtendSpeckleObject(
    SpeckleObject=merge_3,
    BIMSCPROJECT=bimsc_project_2,
    BIMSCORIGINATOR=bimsc_originator_2,
    BIMSCVOLUME=bimsc_volume_2,
    BIMSCLEVEL="L00",
    BIMSCTYPE="SITE",
    BIMSCMATERIAL="SITE",
    RenderMaterial=dso_2.Site,
    BIMSCPHASE="1",
    selectedKitName="Objects")  # -> flatten(ExtendedSpeckleObject)

# ---- group: PHASE
num_5 = Number(Tree({0}: [1], {1}: [1], {2}: [2], {3}: [2], {4}: [3]))

# ---- group: LEVEL
floor_levels_6 = Text(floor_levels_5)

# ----
filter_4 = StreamFilter(Gate=list_3, Stream0=srf_4, Stream1=mesh_17)
name_6 = ExtendSpeckleObject(
    SpeckleObject=filter_4,
    BIMSCPROJECT=bimsc_project_2,
    BIMSCORIGINATOR=bimsc_originator_2,
    BIMSCVOLUME=bimsc_volume_2,
    BIMSCLEVEL=floor_levels_6,
    BIMSCTYPE="TERRAIN",
    BIMSCMATERIAL="soil",
    RenderMaterial=dso_2.Glass,
    BIMSCPHASE=num_5,
    selectedKitName="Objects")  # -> flatten(ExtendedSpeckleObject)

# ---- group: PHASE
num_6 = Number(Tree({0}: [1], {1}: [1], {2}: [2], {3}: [2], {4}: [3]))

# ---- group: LEVEL
floor_levels_7 = Text(floor_levels_5)

# ----
filter_5 = StreamFilter(Gate=list_3, Stream0=brep_7, Stream1=weld_5)
name_7 = ExtendSpeckleObject(
    SpeckleObject=filter_5,
    BIMSCPROJECT=bimsc_project_2,
    BIMSCORIGINATOR=bimsc_originator_2,
    BIMSCVOLUME=bimsc_volume_2,
    BIMSCLEVEL=floor_levels_7,
    BIMSCTYPE="FLOORS UNITS",
    BIMSCMATERIAL="steel",
    RenderMaterial=dso_2.Glass,
    BIMSCPHASE=num_6,
    selectedKitName="Objects")  # -> flatten(ExtendedSpeckleObject)

# ---- group: PHASE
num_7 = Number(Tree({0}: [1], {1}: [1], {2}: [2], {3}: [2], {4}: [3]))

# ---- group: LEVEL
floor_levels_8 = Text(floor_levels_5)

# ----
filter_6 = StreamFilter(Gate=list_3, Stream0=brep_6, Stream1=weld_4)
name_8 = ExtendSpeckleObject(
    SpeckleObject=filter_6,
    BIMSCPROJECT=bimsc_project_2,
    BIMSCORIGINATOR=bimsc_originator_2,
    BIMSCVOLUME=bimsc_volume_2,
    BIMSCLEVEL=floor_levels_8,
    BIMSCTYPE="UNIT WALLS",
    BIMSCMATERIAL="Inflatable",
    RenderMaterial=dso_2.Glass,
    BIMSCPHASE=num_7,
    selectedKitName="Objects")  # -> flatten(ExtendedSpeckleObject)

# ---- group: PHASE
num_8 = Number(Tree({0}: [1], {1}: [1], {2}: [2], {3}: [2], {4}: [3]))

# ---- group: LEVEL
floor_levels_9 = Text(floor_levels_5)

# ----
filter_7 = StreamFilter(Gate=list_3, Stream0=brep_5, Stream1=weld_3)
name_9 = ExtendSpeckleObject(
    SpeckleObject=filter_7,
    BIMSCPROJECT=bimsc_project_2,
    BIMSCORIGINATOR=bimsc_originator_2,
    BIMSCVOLUME=bimsc_volume_2,
    BIMSCLEVEL=floor_levels_9,
    BIMSCTYPE="FLOORS",
    BIMSCMATERIAL="Regolith",
    RenderMaterial=dso_2.Glass,
    BIMSCPHASE=num_8,
    selectedKitName="Objects")  # -> flatten(ExtendedSpeckleObject)

# ---- group: PHASE
num_9 = Number(Slider(3, range=1..3))

# ---- group: LEVEL
floor_levels_10 = Text(floor_levels_5)

# ----
filter_8 = StreamFilter(Gate=list_3, Stream0=brep_4, Stream1=weld_2)
name_10 = ExtendSpeckleObject(
    SpeckleObject=filter_8,
    BIMSCPROJECT=bimsc_project_2,
    BIMSCORIGINATOR=bimsc_originator_2,
    BIMSCVOLUME=bimsc_volume_2,
    BIMSCLEVEL=floor_levels_10,
    BIMSCTYPE="PODS",
    BIMSCMATERIAL="Regolith",
    RenderMaterial=dso_2.Glass,
    BIMSCPHASE=num_9,
    selectedKitName="Objects")  # -> flatten(ExtendedSpeckleObject)

panel_24 = Panel("https://macad.speckle.xyz/streams/4975f9f0a8/branches/site/04-community-site")
receive_4 = Receive(
    Stream=panel_24,
    AutoReceive=False,
    CurrentComponentState="up_to_date",
    ExpandOutput=True,
    LastInfoMessage="James McBennett @ 03/01/2024 23:14:17: 2024 Mar-01 (id:9ec35295b2)",
    ReceiveOnOpen=False,
    ReceivedCommitId="9ec35295b2",
    StreamWrapper="https://macad.speckle.xyz/streams/4975f9f0a8/branches/site/04-community-site",
    selectedKitName="Objects")  # -> Info, CONTOURS, SOIL
# EDIT SITE MESH
item_2 = ListItem(List=flatten(receive_4.SOIL), Index=Slider(3, range=0..17), Wrap=True)
bbox_2 = BoundingBox(Content=srf_5, Plane=PlaneXY(0, 0, 0))  # -> Box, Box_2
volume_2 = Volume(Geometry=bbox_2.Box)  # -> Volume, Centroid
msphere_2 = MeshSphere(Base=volume_2.Centroid, Radius="30000", UCount="100", VCount="100")
msplit_2 = MeshSplit(Mesh=item_2, Splitters=msphere_2)

# ---- group: LEVEL
txt_2 = Text(Tree({0}: ["L00"], {1}: ["L04"]))

# ---- group: PHASE
num_10 = Number(Tree({0}: [1], {1}: [3]))

# ----
filter_9 = StreamFilter(Gate=list_3, Stream0=brep_3, Stream1=weld)  # -> reverse(simplify(graft(Stream)))
name_11 = ExtendSpeckleObject(
    SpeckleObject=filter_9,
    BIMSCPROJECT=bimsc_project_2,
    BIMSCORIGINATOR=bimsc_originator_2,
    BIMSCVOLUME=bimsc_volume_2,
    BIMSCLEVEL=txt_2,
    BIMSCTYPE="WALLS",
    BIMSCMATERIAL="REGOLITH",
    RenderMaterial=dso_2.Regolith,
    BIMSCPHASE=num_10,
    selectedKitName="Objects")

# ---- group: LEVEL
txt_3 = Text(Tree({0}: ["L00"], {1}: ["L04"]))

# ---- group: PHASE
num_11 = Number(Tree({0}: [1], {1}: [3]))

# ----
filter_10 = StreamFilter(Gate=list_3, Stream0=join_3.Breps, Stream1=mesh_11)  # -> reverse(simplify(graft(Stream)))
name_12 = ExtendSpeckleObject(
    SpeckleObject=filter_10,
    BIMSCPROJECT=bimsc_project_2,
    BIMSCORIGINATOR=bimsc_originator_2,
    BIMSCVOLUME=bimsc_volume_2,
    BIMSCLEVEL=txt_3,
    BIMSCTYPE="ROOF",
    BIMSCMATERIAL="Inflatable",
    RenderMaterial=dso_2.Regolith,
    BIMSCPHASE=num_11,
    selectedKitName="Objects")

mmx_2 = MeshMesh(MeshA=item_2, MeshB=msphere_2)
cso_2 = CreateSpeckleObject(
    ROOF=name_12,
    WALL=name_11,
    FLOORS=name_9,
    PODS=name_10,
    UNITS=name_8,
    UNITFLOORS=name_7,
    TERRAIN=name_6,
    selectedKitName="Objects")

# ----
# SEND
panel_25 = Panel("https://macad.speckle.xyz/streams/4975f9f0a8/branches/wip%2Fg06")
send_2 = Send(
    Stream=panel_25,
    Message="Test",
    D=cso_2,
    AutoSend=False,
    BaseId="26703631f992334cb49fab06b5e3b2c5",
    CurrentComponentState="expired",
    KitName="Objects",
    OutputWrappers="https://macad.speckle.xyz\t4975f9f0a8\tb658242c57",
    UseDefaultCache=True,
    selectedKitName="Objects")

# ----
# g06 wip branch
# https://macad.speckle.xyz/streams/4975f9f0a8/branches/wip%2Fg06
# g06 shared branch
# https://macad.speckle.xyz/streams/4975f9f0a8/branches/shared%2Fg06
panel_26 = Panel(send_2)
